# Grasshopper definition FC_REVISED.gh (Grasshopper 1.0.7)

number_slider = Slider(20, range=0..100)
get_number = GetNumber(Slider(20, range=0..100), AtLeast=1, AtMost=1, Maximum=1.797693135e+308, Minimum=-1.797693135e+308, TreeAccess=False)
Y = UnitY(Factor=1)
get_number_2 = GetNumber(Slider(1, range=0..100), AtLeast=1, AtMost=1, Maximum=1.797693135e+308, Minimum=-1.797693135e+308, TreeAccess=False)
get_number_3 = GetNumber(number_slider, AtLeast=1, AtMost=1, Maximum=1.797693135e+308, Minimum=-1.797693135e+308, TreeAccess=False)
get_number_4 = GetNumber(Slider(1, range=0..1), AtLeast=1, AtMost=1, Maximum=1.797693135e+308, Minimum=-1.797693135e+308, TreeAccess=False)
line = LineSDL(Start="0,0,0", Direction=Y, Length=get_number)
series = Series(Start=get_number_4, Step=get_number_2, Count=get_number_3)
get_number_5 = GetNumber(Slider(1, range=0..20), AtLeast=1, AtMost=1, Maximum=1.797693135e+308, Minimum=-1.797693135e+308, TreeAccess=False)
get_number_6 = GetNumber(Slider(0, range=0..10), AtLeast=1, AtMost=1, Maximum=1.797693135e+308, Minimum=-1.797693135e+308, TreeAccess=False)
get_number_7 = GetNumber(Slider(18, range=0..20), AtLeast=1, AtMost=1, Maximum=1.797693135e+308, Minimum=-1.797693135e+308, TreeAccess=False)
get_number_8 = GetNumber(Slider(0, range=0..10), AtLeast=1, AtMost=1, Maximum=1.797693135e+308, Minimum=-1.797693135e+308, TreeAccess=False)
get_number_9 = GetNumber(Slider(12, range=0..20), AtLeast=1, AtMost=1, Maximum=1.797693135e+308, Minimum=-1.797693135e+308, TreeAccess=False)
get_number_10 = GetNumber(Slider(16, range=0..20), AtLeast=1, AtMost=1, Maximum=1.797693135e+308, Minimum=-1.797693135e+308, TreeAccess=False)
get_number_11 = GetNumber(Slider(10, range=0..20), AtLeast=1, AtMost=1, Maximum=1.797693135e+308, Minimum=-1.797693135e+308, TreeAccess=False)
get_number_12 = GetNumber(Slider(0, range=0..10), AtLeast=1, AtMost=1, Maximum=1.797693135e+308, Minimum=-1.797693135e+308, TreeAccess=False)
get_number_13 = GetNumber(Slider(4, range=0..20), AtLeast=1, AtMost=1, Maximum=1.797693135e+308, Minimum=-1.797693135e+308, TreeAccess=False)
X = UnitX(Factor=series)
move = Move(Geometry=line, Motion=X)  # -> Geometry, Transform
pt = ConstructPoint(XCoordinate=get_number_10, YCoordinate=get_number_7, ZCoordinate=get_number_8)
pt_2 = ConstructPoint(XCoordinate=get_number_13, YCoordinate=get_number_11, ZCoordinate=get_number_12)
pt_3 = ConstructPoint(XCoordinate=get_number_9, YCoordinate=get_number_5, ZCoordinate=get_number_6)
divide = DivideCurve(Curve=move.Geometry, Count=number_slider, Kinks=False)  # -> Points, Tangents, Parameters
merge = Merge(Data1=pt_2, Data2=pt, Data3=pt_3)
cp = ClosestPoint(Point=divide.Points, Cloud=merge)  # -> ClosestPoint, CPIndex, Distance
division = Division(A=cp.Distance, B="2")
Z = UnitZ(Factor=division)
neg = Negative(Value=Z)
move_2 = Move(Geometry=divide.Points, Motion=neg)  # -> Geometry, Transform
pline = PolyLine(Vertices=move_2.Geometry, Closed=False)
pline_2 = PolyLine(Vertices=divide.Points, Closed=False)
end = EndPoints(Curve=pline_2)  # -> Start, End
end_2 = EndPoints(Curve=pline)  # -> Start, End
ln = Line(StartPoint=end.Start, EndPoint=end_2.Start)
ln_2 = Line(StartPoint=end.End, EndPoint=end_2.End)
get_number_14 = GetNumber(Slider(0.3, range=0.1..0.9), AtLeast=1, AtMost=1, Maximum=1.797693135e+308, Minimum=-1.797693135e+308, TreeAccess=False)
boundary = BoundarySurfaces(Edges=[pline_2, ln, pline, ln_2])
X_2 = UnitX(Factor=get_number_14)
extr = Extrude(Base=boundary, Direction=X_2)

# ---- group: RH_OUT:MINE
brep = Brep(extr)
