# Grasshopper definition False Ceiling.gh (Grasshopper 1.0.7)

md_slider = MDSlider(
    SliderMode=0,
    slider_value=Point(0.8751657998, 0.6058982291, 0.5),
    x_domain=Domain(0, 1),
    y_domain=Domain(0, 1),
    z_domain=Domain(0, 1))
md_slider_2 = MDSlider(
    SliderMode=0,
    slider_value=Point(0.216381732, 0.312236976, 0.5),
    x_domain=Domain(0, 1),
    y_domain=Domain(0, 1),
    z_domain=Domain(0, 1))
xy = XYPlane(Origin=Point(0, 0, 0))
planesrf = PlaneSurface(Plane=xy, XSize=Domain(-10, 10), YSize=Domain(-10, 10))
get_integer = GetInteger(Slider(12, range=5..15), AtLeast=1, AtMost=1, Maximum=2147483647, Minimum=-2147483648, TreeAccess=False)
get_point = GetPoint([md_slider, md_slider_2], AtLeast=1, AtMost=1, Realtime=True, TreeAccess=False)
sdivide = DivideSurface(Surface=planesrf, UCount=get_integer, VCount=get_integer)  # -> flatten(Points), Normals, Parameters
evalsrf = EvaluateSurface(Surface=reparameterize(planesrf), Point=get_point)  # -> Point, Normal, UDirection, VDirection, Frame
cp = ClosestPoint(Point=sdivide.Points, Cloud=evalsrf.Point)  # -> ClosestPoint, CPIndex, Distance
division = Division(A=cp.Distance, B="2")
Z = UnitZ(Factor=division)
neg = Negative(Value=Z)
move = Move(Geometry=sdivide.Points, Motion=neg)  # -> Geometry, Transform
srfgrid = SurfaceFromPoints(Points=move.Geometry, UCount=expr("x+1", get_integer), Interpolate=False)
crv = Curve(planesrf)
crv_2 = Curve(srfgrid)
loft = Loft(Curves=[crv, crv_2], Options={Adjust=True, Closed=False, LoftEnds=0, LoftSimp=0, LoftType=0, Rebuild=10, Refit=0.01})
merge = Merge(Data1=planesrf, Data2=loft, Data3=srfgrid)
X = UnitX(Factor=1)
join = BrepJoin(Breps=merge)  # -> Breps, Closed
contour = Contour(Shape=join.Breps, Point=Point(0, 0, 0), Direction=X, Distance=Slider(1.5, range=0..10))
X_2 = UnitX(Factor=Slider(0.3, range=0..1))
srf = Surface(contour)
extr = Extrude(Base=srf, Direction=X_2)
rh_out_bench = Brep(extr)
