# Grasshopper definition False Ceiling_Revised.gh (Grasshopper 1.0.7)

md_slider = MDSlider(SliderMode=0, slider_value=Point(0.5, 0.5, 0.5), x_domain=Domain(0, 1), y_domain=Domain(0, 1), z_domain=Domain(0, 1))
md_slider_2 = MDSlider(
    SliderMode=0,
    slider_value=Point(0.260107398, 0.2409162521, 0.5),
    x_domain=Domain(0, 1),
    y_domain=Domain(0, 1),
    z_domain=Domain(0, 1))
xy = XYPlane(Origin=Point(0, 0, 0))
size_of_surface = GetInteger(Slider(8, range=5..20), AtLeast=1, AtMost=1, Maximum=2147483647, Minimum=-2147483648, TreeAccess=False)
attractor_points = GetPoint([md_slider, md_slider_2], AtLeast=1, AtMost=1, Realtime=True, TreeAccess=False)
planesrf = PlaneSurface(Plane=xy, XSize=Domain(-10, 10), YSize=Domain(-10, 10))
sdivide = DivideSurface(Surface=planesrf, UCount=size_of_surface, VCount=size_of_surface)  # -> flatten(Points), Normals, Parameters
evalsrf = EvaluateSurface(Surface=reparameterize(planesrf), Point=attractor_points)  # -> Point, Normal, UDirection, VDirection, Frame
cp = ClosestPoint(Point=sdivide.Points, Cloud=evalsrf.Point)  # -> ClosestPoint, CPIndex, Distance
division = Division(A=cp.Distance, B="2")
Z = UnitZ(Factor=division)
neg = Negative(Value=Z)
move = Move(Geometry=sdivide.Points, Motion=neg)  # -> Geometry, Transform
srfgrid = SurfaceFromPoints(Points=move.Geometry, UCount=expr("x+1", size_of_surface), Interpolate=False)
crv = Curve(planesrf)
crv_2 = Curve(srfgrid)
loft = Loft(Curves=[crv, crv_2], Options={Adjust=True, Closed=False, LoftEnds=0, LoftSimp=0, LoftType=0, Rebuild=10, Refit=0.01})
merge = Merge(Data1=planesrf, Data2=srfgrid, Data3=loft)
spacing = GetNumber(Slider(1.5, range=0..10), AtLeast=1, AtMost=1, Maximum=1.797693135e+308, Minimum=-1.797693135e+308, TreeAccess=False)
join = BrepJoin(Breps=merge)  # -> Breps, Closed
X = UnitX(Factor=1)
contour = Contour(Shape=join.Breps, Point=Point(0, 0, 0), Direction=X, Distance=spacing)
thickness = GetNumber(Slider(0.3, range=0..1), AtLeast=1, AtMost=1, Maximum=1.797693135e+308, Minimum=-1.797693135e+308, TreeAccess=False)
X_2 = UnitX(Factor=thickness)
srf = Surface(contour)
extr = Extrude(Base=srf, Direction=X_2)
rh_out_falseceiling = Brep(extr)
